# Dynamo graph Viaduto_Millau_2023.dyn (Dynamo 2.16.1.2727)

# group: Definição básica do traçado geral do viaduto Millau
# Escola Politécnica da UFRJ. Departamento de Expressão Gráfica
# Autor: Prof. José Luis Menegotto.
# Disciplina: Desenho Computacional
Z1 = DoubleSlider(0, range=0..998830454922681.0 step 0.1)
L = DoubleSlider(2500, range=1000..2500 step 50)
corda = DoubleSlider(150, range=0..150 step 0.1)
altura_mastro = DoubleSlider(145, range=100..200 step 5)
altura_pilone = DoubleSlider(235, range=100..260 step 5)
quantidade_de_estais = DoubleSlider(2, range=2..15 step 1)
parametro_cabo_inferior = DoubleSlider(0.55, range=0.5..0.6 step 0.01)
parametro_cabo_superior = DoubleSlider(0.89, range=0.6..0.9 step 0.01)
code_block = CodeBlock(z1=Z1, longi=L, corda=corda, AltMastro=altura_mastro, AltPilone=altura_pilone, n=quantidade_de_estais, ei=parametro_cabo_inferior, es=parametro_cabo_superior)
# ---------- code_block.designscript (33 lines) ----------
x1 = 0;
y1 = 0;
z1;
longi;
corda;
AltMastro;
AltPist = AltPilone + AltCaix;
AltCaix =  4.50;
Largura = 32.04;
AltPilone;
n;
ei;
es;
p1      = Point.ByCoordinates(x1,y1,z1);
p2      = Point.ByCoordinates(x1+longi/2 ,y1+corda ,z1);
p3      = Point.ByCoordinates(x1+longi   ,y1       ,z1);
Eixo    = Arc.ByThreePoints(p1, p2, p3);
Pista   = Eixo.Translate( 0, 0, AltPist);
Modulos = 8;
Divisor = Modulos - 1;
Comprim = Arc.Length(Eixo);
CaixaoL = Comprim / 280;
PtoPilo = Arc.PointsAtEqualSegmentLength  (Eixo , Modulos);
PtoMast = PtoPilo.Translate ( 0 , 0 , AltPist );
Pilones = Line.ByStartPointDirectionLength ( PtoPilo , Vector.ZAxis(), AltPilone);
Mastros = Line.ByStartPointDirectionLength ( PtoMast , Vector.ZAxis(), AltMastro);

Cabos_m = Line.PointAtParameter( Mastros<1> , ei..es..((es-ei)/n) );
Pini    = Mastros[0].StartPoint;
Caix    = Line.PointsAtSegmentLengthFromPoint ( Pista , Pini , CaixaoL);
Norm    = Line.NormalAtParameter              ( Pista , Line.ParameterAtPoint(Pista, Caix));
Ptt1    = Line.ByStartPointDirectionLength    ( Caix  , Norm ,  Largura/2);
Ptt2    = Line.ByStartPointDirectionLength    ( Caix  , Norm , -Largura/2);
# ----------------------------------------
